% Simulink data dictionary Dt_Dict.sldd

A = Simulink.Signal(StorageClass="ExportedGlobal", DataType="uint8")
B = Simulink.Signal(InitialValue="0", StorageClass="ExportedGlobal", DataType="uint8")
Op = Simulink.Parameter(1, StorageClass="ExportedGlobal", DataType="uint8", Min=0, Max=4)
Res = Simulink.Signal(StorageClass="ExportedGlobal", DataType="int16")